# Grasshopper definition MPDA_HNP_Final.gh (Grasshopper 1.0.8)

read_file = ReadFile(File="C:\MPDA\Session03\MPDA_HNP\MPDA_surface.py", PerLineParse=False)
python_3_script = Python3Script(
    script=read_file,
    amp_h=Slider(5, range=0..20),
    amp_v=Slider(1, range=0..10),
    freq_h=Slider(3, range=0..10),
    freq_v=Slider(1, range=0..10),
    div_u=Slider(7, range=0..50),
    div_v=Slider(14, range=0..50),
    width=Slider(50, range=0..200),
    length=Slider(50, range=0..200),
    height=Slider(20, range=0..50),
    Drop_Height=Slider(20, range=0..50))  # -> mesh, points, strips_u, strips_v; inputs Drop_Height: Int32; unedited script template
mesh = Mesh(python_3_script.mesh)
crv = Curve(python_3_script.strips_u)
crv_2 = Curve(python_3_script.strips_v)
pt = Point(python_3_script.points)
pt_2 = Point(python_3_script.points)
pline = PolyLine(Vertices=pt_2, Closed=False)
polygon = Polygon(Plane=crv, Radius=3, Segments=6, FilletRadius=0)  # -> Polygon, Length
number_slider = Slider(0.937, range=0..1)  # disabled
points = PointList(Points=pt, Size=number_slider)  # disabled
number_slider_2 = Slider(60, range=0..120)  # disabled
panel = Panel("C:\MPDA\Session03\MPDA_HNP\MPDA_Beam.py")  # disabled
number_slider_3 = Slider(32, range=0..50)  # disabled
number_slider_4 = Slider(32, range=0..50)  # disabled
number_slider_5 = Slider(32, range=0..50)  # disabled
item = ListItem(List=pt, Index=number_slider_2, Wrap=True)  # disabled
number_slider_6 = Slider(32, range=0..50)  # disabled
panel_2 = Panel("C:\MPDA\Session03\MPDA_HNP\MPDA_Points.py")  # disabled
read_file_2 = ReadFile(File=panel, PerLineParse=False)  # disabled
number_slider_7 = Slider(10, range=0..10)  # disabled
read_file_3 = ReadFile(File=panel_2, PerLineParse=False)  # disabled
pt_3 = Point(item)  # disabled
python_3_script_2 = Python3Script(
    script_A=read_file_2,
    strips_u=crv,
    strips_v=crv_2,
    width=number_slider_3,
    height=number_slider_4,
    twist_deg=number_slider_5,
    sections=number_slider_6)  # -> breps, frames, profiles; disabled; unedited script template
python_3_script_3 = Python3Script(script=read_file_3, Point=pt_3, Height=number_slider_7)  # -> Mesh; inputs Point: Point3d; disabled; unedited script template
pipe = Pipe(Radius=1, Caps=0, FitRail=False)  # disabled
mesh_2 = Mesh(python_3_script_3)  # disabled
panel_3 = Panel(python_3_script_2.profiles)  # disabled
panel_4 = Panel(python_3_script_3)  # disabled
rec = Rectangle(python_3_script_2.profiles)  # disabled
